# Grasshopper definition example.gh (Grasshopper 1.0.8)
# plug-ins: Pawper

_01_textblocks = TextBlocks(Text="Questo documento è stato generato con Pawper. Il testo rimane modificabile in Microsoft Word.")
_02_quickdoc = QuickDocument(Title="Primo documento", Blocks=_01_textblocks)
_03_inspect = DocumentInspector(Document=_02_quickdoc)  # -> Structure, Styles, Bookmarks, Controls, Metadata, Validation
_05_path = ProjectPath(RelativePath="output.docx")
_04_save = SaveWord(Document=_02_quickdoc, Path=_05_path, Run=False, Overwrite=False)  # -> Path, Status
_07_path = ProjectPath(RelativePath="output.docx")
_06_open = OpenResult(Path=_07_path, Run=False)
