# Grasshopper definition example.gh (Grasshopper 1.0.8)
# plug-ins: Pawper

_01_new = NewDocument()
_03_heading = Heading(Text="Stili del progetto", Level=0)
_04_heading = Heading(Text="Sottotitolo della relazione", Level=-1)
_05_paragraph = Paragraph(Text="Questo paragrafo applica ProjectBody.", StyleID="ProjectBody")
_06_heading = Heading(Text="Intestazione livello 1", Level=1)
_07_heading = Heading(Text="Intestazione livello 2", Level=2)
_08_heading = Heading(Text="Intestazione livello 3", Level=3)
_09_heading = Heading(Text="Intestazione livello 4", Level=4)
_10_heading = Heading(Text="Intestazione livello 5", Level=5)
_11_heading = Heading(Text="Intestazione livello 6", Level=6)
_12_heading = Heading(Text="Intestazione livello 7", Level=7)
_13_heading = Heading(Text="Intestazione livello 8", Level=8)
_14_heading = Heading(Text="Intestazione livello 9", Level=9)
_16_run = TextRun(
    Text="Stile carattere Evidenza",
    Font="Aptos",
    Size=11,
    Bold=False,
    Italic=False,
    Underline=False,
    Color="000000",
    Script="baseline",
    StyleID="EmphasisProject")
_15_paragraph = Paragraph(Runs=_16_run, StyleID="Normal")
_18_cell = TableCell(Text="Elemento", ColumnSpan=1, RowSpan=1, Alignment="left")
_19_cell = TableCell(Text="Valore", ColumnSpan=1, RowSpan=1, Alignment="left")
_20_cell = TableCell(Text="Unità", ColumnSpan=1, RowSpan=1, Alignment="left")
_21_cell = TableCell(Text="Luce", ColumnSpan=1, RowSpan=1, Alignment="left")
_22_cell = TableCell(Text="6,50", ColumnSpan=1, RowSpan=1, Alignment="right")
_23_cell = TableCell(Text="m", ColumnSpan=1, RowSpan=1, Alignment="left")
_24_cell = TableCell(Text="Carico", ColumnSpan=1, RowSpan=1, Alignment="left")
_25_cell = TableCell(Text="12,35", ColumnSpan=1, RowSpan=1, Alignment="right")
_26_cell = TableCell(Text="kN/m", ColumnSpan=1, RowSpan=1, Alignment="left")
_27_cell = TableCell(Text="Dato mancante", ColumnSpan=1, RowSpan=1, Alignment="left")
_28_cell = TableCell(ColumnSpan=1, RowSpan=1, Alignment="left")
_29_cell = TableCell(ColumnSpan=1, RowSpan=1, Alignment="left")
_17_rows = TableRows(
    Cells=[_18_cell, _19_cell, _20_cell, _21_cell, _22_cell, _23_cell, _24_cell, _25_cell, _26_cell, _27_cell, _28_cell, _29_cell],
    Counts=[3, 3, 3, 3])
_30_table = WordTable(
    Rows=_17_rows,
    WidthsMm=[70, 45, 40],
    Header=True,
    Options="""{
  "HeaderFill": "24445C",
  "StripeFill": "EEF3F6",
  "BorderColor": "CBD5DD",
  "PaddingMm": 2,
  "StyleId": "ProjectTable"
}""")
_31_style = WordStyle(
    ID="ProjectBody",
    Name="Testo progetto",
    BasedOn="Normal",
    RunFormat="""{
  "Font": "Aptos",
  "Size": 11,
  "Bold": false,
  "Italic": false,
  "Underline": false,
  "Color": "24445C",
  "Script": null
}""",
    ParagraphFormat="""{
  "Alignment": "left",
  "Before": 0,
  "After": 8,
  "Line": 1.15,
  "LeftMm": 0,
  "RightMm": 0,
  "FirstLineMm": 0,
  "KeepNext": false
}""",
    Type="paragraph")
_32_style = WordStyle(
    ID="EmphasisProject",
    Name="Evidenza",
    BasedOn="Normal",
    RunFormat="""{
  "Font": null,
  "Size": null,
  "Bold": false,
  "Italic": true,
  "Underline": false,
  "Color": null,
  "Script": null
}""",
    ParagraphFormat="""{
  "Alignment": "left",
  "Before": 0,
  "After": 6,
  "Line": 1.15,
  "LeftMm": 0,
  "RightMm": 0,
  "FirstLineMm": 0,
  "KeepNext": false
}""",
    Type="character")
_33_style = WordStyle(
    ID="ProjectTable",
    Name="Tabella progetto",
    BasedOn="Normal",
    RunFormat="""{
  "Font": "Aptos",
  "Size": 11,
  "Bold": false,
  "Italic": false,
  "Underline": false,
  "Color": null,
  "Script": null
}""",
    ParagraphFormat="""{
  "Alignment": "left",
  "Before": 0,
  "After": 6,
  "Line": 1.15,
  "LeftMm": 0,
  "RightMm": 0,
  "FirstLineMm": 0,
  "KeepNext": false
}""",
    Type="table")
_02_compose = ComposeDocument(
    Document=_01_new,
    Blocks=flatten([_03_heading, _04_heading, _05_paragraph, _06_heading, _07_heading, _08_heading, _09_heading, _10_heading, _11_heading, _12_heading, _13_heading, _14_heading, _15_paragraph, _30_table]),
    Styles=[_31_style, _32_style, _33_style])
_34_inspect = DocumentInspector(Document=_02_compose)  # -> Structure, Styles, Bookmarks, Controls, Metadata, Validation
_36_path = ProjectPath(RelativePath="output.docx")
_35_save = SaveWord(Document=_02_compose, Path=_36_path, Run=False, Overwrite=False)  # -> Path, Status
_38_path = ProjectPath(RelativePath="output.docx")
_37_open = OpenResult(Path=_38_path, Run=False)
