# Grasshopper definition example.gh (Grasshopper 1.0.8)
# plug-ins: Pawper

_01_new = NewDocument()
_03_heading = Heading(Text="Equazioni native", Level=0)
_05_run = TextRun(
    Text="La relazione ",
    Font="Aptos",
    Size=11,
    Bold=False,
    Italic=False,
    Underline=False,
    Color="000000",
    Script="baseline")
_06_run = TextRun(
    Font="Aptos",
    Size=11,
    Bold=False,
    Italic=False,
    Underline=False,
    Color="000000",
    Script="baseline",
    Math="\sigma=\frac{N}{A}")
_07_run = TextRun(
    Text=" è una formula inline modificabile.",
    Font="Aptos",
    Size=11,
    Bold=False,
    Italic=False,
    Underline=False,
    Color="000000",
    Script="baseline")
_04_paragraph = Paragraph(Runs=[_05_run, _06_run, _07_run], StyleID="Normal")
_08_equation = WordEquation(LaTeX="x_1^2+\sqrt[3]{a}=\frac{b}{c}", Inline=False, Numbered=False)
_09_equation = WordEquation(LaTeX="\alpha+\beta+\gamma=\pi", Inline=True, Numbered=False)
_02_compose = ComposeDocument(Document=_01_new, Blocks=flatten([_03_heading, _04_paragraph, _08_equation, _09_equation]))
_10_inspect = DocumentInspector(Document=_02_compose)  # -> Structure, Styles, Bookmarks, Controls, Metadata, Validation
_12_path = ProjectPath(RelativePath="output.docx")
_11_save = SaveWord(Document=_02_compose, Path=_12_path, Run=False, Overwrite=False)  # -> Path, Status
_14_path = ProjectPath(RelativePath="output.docx")
_13_open = OpenResult(Path=_14_path, Run=False)
