# Grasshopper definition example.gh (Grasshopper 1.0.8)
# plug-ins: Pawper

_01_new = NewDocument()
_03_heading = Heading(Text="Relazione con sezioni", Level=0)
_04_paragraph = Paragraph(Text="Prima pagina con intestazione dedicata.", StyleID="Normal")
_05_break = PageBreak()
_06_heading = Heading(Text="Seconda pagina", Level=1)
_07_paragraph = Paragraph(Text="Verifica intestazioni pari e numerazione.", StyleID="Normal")
_09_layout = PageLayout(
    WidthMm=215.9,
    HeightMm=279.4,
    MarginMm=20,
    Landscape=False,
    Advanced="""{
  "WidthMm": 210,
  "HeightMm": 297,
  "MarginMm": 20,
  "Landscape": true,
  "Header": "Sezione orizzontale",
  "Footer": "Pagina {{PAGE}}",
  "FirstHeader": null,
  "FirstFooter": null,
  "EvenHeader": null,
  "EvenFooter": null,
  "PageStart": 1
}""")
_10_heading = Heading(Text="Tabella orizzontale", Level=1)
_12_cell = TableCell(Text="Elemento", ColumnSpan=1, RowSpan=1, Alignment="left")
_13_cell = TableCell(Text="Valore", ColumnSpan=1, RowSpan=1, Alignment="left")
_14_cell = TableCell(Text="Unità", ColumnSpan=1, RowSpan=1, Alignment="left")
_15_cell = TableCell(Text="Luce", ColumnSpan=1, RowSpan=1, Alignment="left")
_16_cell = TableCell(Text="6,50", ColumnSpan=1, RowSpan=1, Alignment="right")
_17_cell = TableCell(Text="m", ColumnSpan=1, RowSpan=1, Alignment="left")
_18_cell = TableCell(Text="Carico", ColumnSpan=1, RowSpan=1, Alignment="left")
_19_cell = TableCell(Text="12,35", ColumnSpan=1, RowSpan=1, Alignment="right")
_20_cell = TableCell(Text="kN/m", ColumnSpan=1, RowSpan=1, Alignment="left")
_21_cell = TableCell(Text="Dato mancante", ColumnSpan=1, RowSpan=1, Alignment="left")
_22_cell = TableCell(ColumnSpan=1, RowSpan=1, Alignment="left")
_23_cell = TableCell(ColumnSpan=1, RowSpan=1, Alignment="left")
_11_rows = TableRows(
    Cells=[_12_cell, _13_cell, _14_cell, _15_cell, _16_cell, _17_cell, _18_cell, _19_cell, _20_cell, _21_cell, _22_cell, _23_cell],
    Counts=[3, 3, 3, 3])
_24_table = WordTable(
    Rows=_11_rows,
    WidthsMm=[70, 45, 40],
    Header=True,
    Options="""{
  "HeaderFill": "24445C",
  "StripeFill": "EEF3F6",
  "BorderColor": "CBD5DD",
  "PaddingMm": 2,
  "StyleId": null
}""")
_08_section = Section(Layout=_09_layout, Blocks=[_10_heading, _24_table])
_25_layout = PageLayout(WidthMm=215.9, HeightMm=279.4, MarginMm=20, Landscape=False, Advanced="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")
_02_compose = ComposeDocument(
    Document=_01_new,
    Blocks=flatten([_03_heading, _04_paragraph, _05_break, _06_heading, _07_paragraph, _08_section]),
    Layout=_25_layout)
_26_inspect = DocumentInspector(Document=_02_compose)  # -> Structure, Styles, Bookmarks, Controls, Metadata, Validation
_28_path = ProjectPath(RelativePath="output.docx")
_27_save = SaveWord(Document=_02_compose, Path=_28_path, Run=False, Overwrite=False)  # -> Path, Status
_30_path = ProjectPath(RelativePath="output.docx")
_29_open = OpenResult(Path=_30_path, Run=False)
