# Grasshopper definition example.gh (Grasshopper 1.0.8)
# plug-ins: Pawper

_02_path = ProjectPath(RelativePath="../assets/template.docx")
_03_paragraph = Paragraph(Text="Aggiunta con stile del template", StyleID="ProjectBody")
_01_quickdoc = QuickDocument(Blocks=_03_paragraph, TemplatePath=_02_path)
_04_fillfields = FillFields(
    Document=_01_quickdoc,
    Names=["{{Progetto}}", "{{Cliente}}"],
    Values=["Edificio dimostrativo", "Cliente esempio"],
    Strict=True)
_05_inspect = DocumentInspector(Document=_04_fillfields)  # -> Structure, Styles, Bookmarks, Controls, Metadata, Validation
_07_path = ProjectPath(RelativePath="output.docx")
_06_save = SaveWord(Document=_04_fillfields, Path=_07_path, Run=False, Overwrite=False)  # -> Path, Status
_09_path = ProjectPath(RelativePath="output.docx")
_08_open = OpenResult(Path=_09_path, Run=False)
