# Grasshopper definition example.gh (Grasshopper 1.0.8)
# plug-ins: Pawper

_01_new = NewDocument()
_03_heading = Heading(Text="Relazione tecnica dimostrativa", Level=0)
_04_heading = Heading(Text="Progetto di una trave appoggiata", Level=-1)
_06_paraformat = ParagraphFormat(Alignment="left", BeforePt=0, AfterPt=6, Line=1.15, KeepNext=False)
_05_paragraph = Paragraph(Text="Esempio completo di documentazione parametrica generata da Grasshopper.", StyleID="Normal", Format=_06_paraformat)
_07_break = PageBreak()
_08_heading = Heading(Text="Sommario", Level=1)
_09_field = WordField(Instruction="TOC \\o \"1-3\" \\h \\z \\u", Placeholder="Aggiornare il campo in Word", StyleID="Normal")
_10_heading = Heading(Text="Dati del modello", Level=1)
_11_quicktable = QuickTable(
    Data=Tree({2;10}: ["Luce", 6.5, "m"], {2;13}: ["Carico", 12.3456, "kN/m"], {2;16}: ["Dato mancante"]),
    Headers=["Elemento", "Valore", "Unità"],
    Columns=False,
    Decimals=2,
    Culture="it-IT",
    WidthsMm=[70, 45, 40],
    Strict=False)  # -> Block, Rows
_12_heading = Heading(Text="Schema e risultati", Level=1)
_13_image = WordImage(
    PathOrBase64=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,
    WidthMm=120,
    AltText="Schema di una trave appoggiata con carico distribuito",
    Caption="Schema geometrico dimostrativo",
    Format="png",
    Alignment="center")
_14_equation = WordEquation(LaTeX="M_{max}=\frac{qL^2}{8}", Inline=False, Numbered=True, Bookmark="Momento")
_16_paraformat = ParagraphFormat(Alignment="left", BeforePt=0, AfterPt=6, Line=1.15, KeepNext=False)
_15_paragraph = Paragraph(
    Text="La formula e i dati hanno finalità dimostrative e non costituiscono una verifica strutturale.",
    StyleID="Normal",
    Format=_16_paraformat)
_17_note = WordNote(Anchor="Ipotesi di modello", Text="Il modello rappresenta una trave semplicemente appoggiata.", Endnote=False)
_19_pagepreset = PagePreset(Format="A4", Landscape=True, MarginMm=20, Header="Appendice", Footer="Pagina {{PAGE}}")
_20_heading = Heading(Text="Appendice tabellare", Level=1)
_21_quicktable = QuickTable(
    Data=Tree({2;10}: ["Luce", 6.5, "m"], {2;13}: ["Carico", 12.3456, "kN/m"], {2;16}: ["Dato mancante"]),
    Headers=["Elemento", "Valore", "Unità"],
    Columns=False,
    Decimals=2,
    Culture="it-IT",
    WidthsMm=[70, 45, 40],
    Strict=False)  # -> Block, Rows
_18_section = Section(Layout=_19_pagepreset, Blocks=[_20_heading, _21_quicktable.Block])
_22_pagepreset = PagePreset(Format="A4", Landscape=False, MarginMm=20, Header="Pawper — Relazione tecnica", Footer="Pagina {{PAGE}} di {{NUMPAGES}}")
_02_compose = ComposeDocument(
    Document=_01_new,
    Blocks=flatten([_03_heading, _04_heading, _05_paragraph, _07_break, _08_heading, _09_field, _10_heading, _11_quicktable.Block, _12_heading, _13_image, _14_equation, _15_paragraph, _17_note, _18_section]),
    Layout=_22_pagepreset)
_23_metadata = DocumentMetadata(
    Document=_02_compose,
    Title="Relazione tecnica dimostrativa",
    Author="Pawper",
    Subject="Esempio completo",
    Keywords="relazione;Grasshopper",
    Custom="{}")
_24_inspect = DocumentInspector(Document=_23_metadata)  # -> Structure, Styles, Bookmarks, Controls, Metadata, Validation
_26_path = ProjectPath(RelativePath="output.docx")
_25_save = SaveWord(Document=_23_metadata, Path=_26_path, Run=False, Overwrite=False)  # -> Path, Status
_28_path = ProjectPath(RelativePath="output.docx")
_27_open = OpenResult(Path=_28_path, Run=False)
